# Grasshopper definition Assignment_01_Giovanni-Carlo-Volpe.gh (Grasshopper 1.0.8)
# plug-ins: eleFront5

dom = ConstructDomain(DomainStart=0, DomainEnd=Slider(2.5, range=0..10))
dom_2 = ConstructDomain(DomainStart=0, DomainEnd=Slider(4, range=0..10))
dom_3 = ConstructDomain(DomainStart=Slider(-4, range=-10..10), DomainEnd=Slider(4, range=-10..10))
dom_4 = ConstructDomain(DomainStart=Slider(0, range=-10..10), DomainEnd=Slider(8, range=-10..10))
box = DomainBox(Base=PlaneXY(0, 0, 0), X=dom_3, Y=dom_4, Z=dom_2)
debrep = DeconstructBrep(Brep=box)  # -> Faces, Edges, Vertices
item = ListItem(List=debrep.Faces, Index=0, Wrap=True)
item_2 = EleFrontDataDescription(item, ShiftDepth=0, isNameSet=False)
debrep_2 = DeconstructBrep(Brep=item_2)  # -> Faces, Edges, Vertices
midpt = CurveMiddle(Curve=debrep_2.Edges)
pdecon = Deconstruct(Point=midpt)  # -> XComponent, YComponent, ZComponent
pln = Plane(item_2)
deplane = DeconstructPlane(Plane=pln)  # -> Origin, XAxis, YAxis, ZAxis
sort = SortList(Keys=pdecon.ZComponent, ValuesA=debrep_2.Edges)  # -> Keys, ValuesA
item_3 = ListItem(List=sort.ValuesA, Index=0, Wrap=True)
midpt_2 = CurveMiddle(Curve=item_3)
pl = ConstructPlane(Origin=midpt_2, XAxis=deplane.XAxis, YAxis=deplane.YAxis)
rectangle = Rectangle(Plane=pl, XSize=Domain(-1, 1), YSize=dom, Radius=0)  # -> Rectangle, Length
smesh = SimpleMesh(Brep=rectangle.Rectangle)
foyer = SimpleMesh(Brep=box)

foyer_2 = Mesh(foyer)

dom_5 = ConstructDomain(DomainStart=0, DomainEnd=Slider(4, range=0..10))
dom_6 = ConstructDomain(DomainStart=Slider(4, range=-10..10), DomainEnd=Slider(12, range=-10..24))
dom_7 = ConstructDomain(DomainStart=Slider(0, range=-10..10), DomainEnd=Slider(2, range=-10..10))
box_2 = DomainBox(Base=PlaneXY(0, 0, 0), X=dom_6, Y=dom_7, Z=dom_5)
smesh_2 = SimpleMesh(Brep=box_2)

dom_8 = ConstructDomain(DomainStart=0, DomainEnd=Slider(4, range=0..10))
dom_9 = ConstructDomain(DomainStart=Slider(4, range=-10..10), DomainEnd=Slider(12, range=-10..30))
dom_10 = ConstructDomain(DomainStart=Slider(4, range=-10..10), DomainEnd=Slider(6, range=-10..10))
box_3 = DomainBox(Base=PlaneXY(0, 0, 0), X=dom_9, Y=dom_10, Z=dom_8)
smesh_3 = SimpleMesh(Brep=box_3)

dom_11 = ConstructDomain(DomainStart=0, DomainEnd=Slider(4, range=0..10))
dom_12 = ConstructDomain(DomainStart=Slider(4, range=-10..10), DomainEnd=Slider(12, range=-10..30))
dom_13 = ConstructDomain(DomainStart=Slider(2, range=-10..10), DomainEnd=Slider(4, range=-10..10))
dom_14 = ConstructDomain(DomainStart=0, DomainEnd=Slider(4, range=0..10))
dom_15 = ConstructDomain(DomainStart=Slider(4, range=-10..10), DomainEnd=Slider(12, range=-10..30))
dom_16 = ConstructDomain(DomainStart=Slider(6, range=-10..10), DomainEnd=Slider(8, range=-10..10))

debrep_3 = DeconstructBrep(Brep=box_2)  # -> Faces, Edges, Vertices
item_4 = ListItem(List=debrep_3.Faces, Index=Slider(1, range=0..5), Wrap=True)
item_5 = EleFrontDataDescription(item_4, ShiftDepth=0, isNameSet=False)
debrep_4 = DeconstructBrep(Brep=item_5)  # -> Faces, Edges, Vertices
midpt_3 = CurveMiddle(Curve=debrep_4.Edges)
pdecon_2 = Deconstruct(Point=midpt_3)  # -> XComponent, YComponent, ZComponent
pln_2 = Plane(item_5)
dom_17 = ConstructDomain(DomainStart=Slider(-0.5, range=-1..1), DomainEnd=Slider(0.5, range=-1..1))
dom_18 = ConstructDomain(DomainStart=0, DomainEnd=Slider(2, range=0..10))
deplane_2 = DeconstructPlane(Plane=pln_2)  # -> Origin, XAxis, YAxis, ZAxis
sort_2 = SortList(Keys=pdecon_2.ZComponent, ValuesA=debrep_4.Edges)  # -> Keys, ValuesA
item_6 = ListItem(List=sort_2.ValuesA, Index=0, Wrap=True)
midpt_4 = CurveMiddle(Curve=item_6)
pl_2 = ConstructPlane(Origin=midpt_4, XAxis=deplane_2.XAxis, YAxis=deplane_2.YAxis)
rectangle_2 = Rectangle(Plane=pl_2, XSize=dom_17, YSize=dom_18, Radius=0)  # -> Rectangle, Length
smesh_4 = SimpleMesh(Brep=rectangle_2.Rectangle)

box_4 = DomainBox(Base=PlaneXY(0, 0, 0), X=dom_12, Y=dom_13, Z=dom_11)
box_5 = DomainBox(Base=PlaneXY(0, 0, 0), X=dom_15, Y=dom_16, Z=dom_14)
debrep_5 = DeconstructBrep(Brep=box_5)  # -> Faces, Edges, Vertices

item_7 = ListItem(List=debrep_5.Faces, Index=Slider(1, range=0..5), Wrap=True)
item_8 = EleFrontDataDescription(item_7, ShiftDepth=0, isNameSet=False)
debrep_6 = DeconstructBrep(Brep=item_8)  # -> Faces, Edges, Vertices
midpt_5 = CurveMiddle(Curve=debrep_6.Edges)
pdecon_3 = Deconstruct(Point=midpt_5)  # -> XComponent, YComponent, ZComponent
pln_3 = Plane(item_8)
dom_19 = ConstructDomain(DomainStart=Slider(-0.5, range=-1..1), DomainEnd=Slider(0.5, range=-1..1))
dom_20 = ConstructDomain(DomainStart=0, DomainEnd=Slider(2, range=0..10))
deplane_3 = DeconstructPlane(Plane=pln_3)  # -> Origin, XAxis, YAxis, ZAxis
sort_3 = SortList(Keys=pdecon_3.ZComponent, ValuesA=debrep_6.Edges)  # -> Keys, ValuesA
item_9 = ListItem(List=sort_3.ValuesA, Index=0, Wrap=True)
midpt_6 = CurveMiddle(Curve=item_9)
pl_3 = ConstructPlane(Origin=midpt_6, XAxis=deplane_3.XAxis, YAxis=deplane_3.YAxis)
rectangle_3 = Rectangle(Plane=pl_3, XSize=dom_19, YSize=dom_20, Radius=0)  # -> Rectangle, Length
smesh_5 = SimpleMesh(Brep=rectangle_3.Rectangle)

debrep_7 = DeconstructBrep(Brep=box_4)  # -> Faces, Edges, Vertices
item_10 = ListItem(List=debrep_7.Faces, Index=Slider(1, range=0..5), Wrap=True)
item_11 = EleFrontDataDescription(item_10, ShiftDepth=0, isNameSet=False)
debrep_8 = DeconstructBrep(Brep=item_11)  # -> Faces, Edges, Vertices
midpt_7 = CurveMiddle(Curve=debrep_8.Edges)
dom_21 = ConstructDomain(DomainStart=Slider(-0.5, range=-1..1), DomainEnd=Slider(0.5, range=-1..1))
pdecon_4 = Deconstruct(Point=midpt_7)  # -> XComponent, YComponent, ZComponent
pln_4 = Plane(item_11)
dom_22 = ConstructDomain(DomainStart=0, DomainEnd=Slider(2.1, range=0..10))
deplane_4 = DeconstructPlane(Plane=pln_4)  # -> Origin, XAxis, YAxis, ZAxis
sort_4 = SortList(Keys=pdecon_4.ZComponent, ValuesA=debrep_8.Edges)  # -> Keys, ValuesA
item_12 = ListItem(List=sort_4.ValuesA, Index=0, Wrap=True)
midpt_8 = CurveMiddle(Curve=item_12)
pl_4 = ConstructPlane(Origin=midpt_8, XAxis=deplane_4.XAxis, YAxis=deplane_4.YAxis)
rectangle_4 = Rectangle(Plane=pl_4, XSize=dom_21, YSize=dom_22, Radius=0)  # -> Rectangle, Length
smesh_6 = SimpleMesh(Brep=rectangle_4.Rectangle)

item_13 = ListItem(List=debrep_3.Faces, Index=Slider(3, range=0..5), Wrap=True)
item_14 = EleFrontDataDescription(item_13, ShiftDepth=0, isNameSet=False)
debrep_9 = DeconstructBrep(Brep=item_14)  # -> Faces, Edges, Vertices
midpt_9 = CurveMiddle(Curve=debrep_9.Edges)
pdecon_5 = Deconstruct(Point=midpt_9)  # -> XComponent, YComponent, ZComponent
pln_5 = Plane(item_14)
dom_23 = ConstructDomain(DomainStart=Slider(-0.5, range=-1..1), DomainEnd=Slider(0.5, range=-1..1))
dom_24 = ConstructDomain(DomainStart=0, DomainEnd=Slider(2, range=0..10))
deplane_5 = DeconstructPlane(Plane=pln_5)  # -> Origin, XAxis, YAxis, ZAxis
sort_5 = SortList(Keys=pdecon_5.ZComponent, ValuesA=debrep_9.Edges)  # -> Keys, ValuesA
item_15 = ListItem(List=sort_5.ValuesA, Index=0, Wrap=True)
midpt_10 = CurveMiddle(Curve=item_15)
pl_5 = ConstructPlane(Origin=midpt_10, XAxis=deplane_5.XAxis, YAxis=deplane_5.YAxis)
rectangle_5 = Rectangle(Plane=pl_5, XSize=dom_23, YSize=dom_24, Radius=0)  # -> Rectangle, Length
smesh_7 = SimpleMesh(Brep=rectangle_5.Rectangle)

debrep_10 = DeconstructBrep(Brep=box_3)  # -> Faces, Edges, Vertices
item_16 = ListItem(List=debrep_10.Faces, Index=Slider(1, range=0..5), Wrap=True)
item_17 = EleFrontDataDescription(item_16, ShiftDepth=0, isNameSet=False)
debrep_11 = DeconstructBrep(Brep=item_17)  # -> Faces, Edges, Vertices
midpt_11 = CurveMiddle(Curve=debrep_11.Edges)
dom_25 = ConstructDomain(DomainStart=Slider(-0.5, range=-1..1), DomainEnd=Slider(0.5, range=-1..1))
pdecon_6 = Deconstruct(Point=midpt_11)  # -> XComponent, YComponent, ZComponent
pln_6 = Plane(item_17)
dom_26 = ConstructDomain(DomainStart=0, DomainEnd=Slider(2.1, range=0..10))
deplane_6 = DeconstructPlane(Plane=pln_6)  # -> Origin, XAxis, YAxis, ZAxis
sort_6 = SortList(Keys=pdecon_6.ZComponent, ValuesA=debrep_11.Edges)  # -> Keys, ValuesA
item_18 = ListItem(List=sort_6.ValuesA, Index=0, Wrap=True)
midpt_12 = CurveMiddle(Curve=item_18)
pl_6 = ConstructPlane(Origin=midpt_12, XAxis=deplane_6.XAxis, YAxis=deplane_6.YAxis)
rectangle_6 = Rectangle(Plane=pl_6, XSize=dom_25, YSize=dom_26, Radius=0)  # -> Rectangle, Length
smesh_8 = SimpleMesh(Brep=rectangle_6.Rectangle)

item_19 = ListItem(List=debrep_10.Faces, Index=Slider(0, range=0..5), Wrap=True)
item_20 = EleFrontDataDescription(item_19, ShiftDepth=0, isNameSet=False)
debrep_12 = DeconstructBrep(Brep=item_20)  # -> Faces, Edges, Vertices
midpt_13 = CurveMiddle(Curve=debrep_12.Edges)
dom_27 = ConstructDomain(DomainStart=Slider(-0.6, range=-1..1), DomainEnd=Slider(0.6, range=-1..1))
pln_7 = Plane(item_20)
pdecon_7 = Deconstruct(Point=midpt_13)  # -> XComponent, YComponent, ZComponent
dom_28 = ConstructDomain(DomainStart=0, DomainEnd=Slider(2.5, range=0..10))
deplane_7 = DeconstructPlane(Plane=pln_7)  # -> Origin, XAxis, YAxis, ZAxis
sort_7 = SortList(Keys=pdecon_7.ZComponent, ValuesA=debrep_12.Edges)  # -> Keys, ValuesA
item_21 = ListItem(List=sort_7.ValuesA, Index=0, Wrap=True)
midpt_14 = CurveMiddle(Curve=item_21)
pl_7 = ConstructPlane(Origin=midpt_14, XAxis=deplane_7.XAxis, YAxis=deplane_7.YAxis)
rectangle_7 = Rectangle(Plane=pl_7, XSize=dom_27, YSize=dom_28, Radius=0)  # -> Rectangle, Length
smesh_9 = SimpleMesh(Brep=rectangle_7.Rectangle)

smesh_10 = SimpleMesh(Brep=box_4)
smesh_11 = SimpleMesh(Brep=box_5)

item_22 = ListItem(List=debrep_5.Faces, Index=Slider(3, range=0..5), Wrap=True)
item_23 = EleFrontDataDescription(item_22, ShiftDepth=0, isNameSet=False)
debrep_13 = DeconstructBrep(Brep=item_23)  # -> Faces, Edges, Vertices
midpt_15 = CurveMiddle(Curve=debrep_13.Edges)
pdecon_8 = Deconstruct(Point=midpt_15)  # -> XComponent, YComponent, ZComponent
pln_8 = Plane(item_23)
dom_29 = ConstructDomain(DomainStart=Slider(-0.5, range=-1..1), DomainEnd=Slider(0.5, range=-1..1))
dom_30 = ConstructDomain(DomainStart=0, DomainEnd=Slider(2, range=0..10))
deplane_8 = DeconstructPlane(Plane=pln_8)  # -> Origin, XAxis, YAxis, ZAxis
sort_8 = SortList(Keys=pdecon_8.ZComponent, ValuesA=debrep_13.Edges)  # -> Keys, ValuesA
item_24 = ListItem(List=sort_8.ValuesA, Index=0, Wrap=True)
midpt_16 = CurveMiddle(Curve=item_24)
pl_8 = ConstructPlane(Origin=midpt_16, XAxis=deplane_8.XAxis, YAxis=deplane_8.YAxis)
rectangle_8 = Rectangle(Plane=pl_8, XSize=dom_29, YSize=dom_30, Radius=0)  # -> Rectangle, Length
smesh_12 = SimpleMesh(Brep=rectangle_8.Rectangle)

dom_31 = ConstructDomain(DomainStart=0, DomainEnd=Slider(4, range=0..10))
dom_32 = ConstructDomain(DomainStart=Slider(12, range=-10..50), DomainEnd=Slider(17, range=-10..20))
dom_33 = ConstructDomain(DomainStart=Slider(0, range=-10..10), DomainEnd=Slider(4, range=-10..10))
dom_34 = ConstructDomain(DomainStart=0, DomainEnd=Slider(4, range=0..10))
dom_35 = ConstructDomain(DomainStart=Slider(12, range=-10..50), DomainEnd=Slider(17, range=-10..40))
dom_36 = ConstructDomain(DomainStart=Slider(4, range=-10..10), DomainEnd=Slider(8, range=-10..10))
box_6 = DomainBox(Base=PlaneXY(0, 0, 0), X=dom_32, Y=dom_33, Z=dom_31)
box_7 = DomainBox(Base=PlaneXY(0, 0, 0), X=dom_35, Y=dom_36, Z=dom_34)
smesh_13 = SimpleMesh(Brep=box_6)
entwine = Entwine(
    Branch00=smesh_12,
    Branch01=smesh_5,
    Branch02=smesh_8,
    Branch03=smesh_9,
    Branch04=smesh_6,
    Branch05=smesh_7,
    Branch06=smesh_4,
    FlattenInputs=True)
yz = YZPlane(Origin=Point(0, 0, 0))
smesh_14 = SimpleMesh(Brep=box_7)
entwine_2 = Entwine(
    Branch00=smesh_11,
    Branch01=smesh_3,
    Branch02=smesh_10,
    Branch03=smesh_2,
    Branch04=smesh_14,
    Branch05=smesh_13,
    FlattenInputs=True)
mirror = Mirror(Geometry=entwine, Plane=yz)  # -> Geometry, Transform
yz_2 = YZPlane(Origin=Point(0, 0, 0))
mirror_2 = Mirror(Geometry=entwine_2, Plane=yz_2)  # -> Geometry, Transform
