# Grasshopper definition UUU.gh (Grasshopper 1.0.8)

crv = Curve([<curve referenced from the Rhino model> x25])
crv_2 = Curve([<curve referenced from the Rhino model> x9])
cls = Closed(Curve=crv)  # -> Closed, Periodic
cls_2 = Closed(Curve=crv_2)  # -> Closed, Periodic
cx = CurveSelf(Curve=crv)  # -> Points, Params
cx_2 = CurveSelf(Curve=crv_2)  # -> Points, Params
lng = ListLength(List=flatten(cx.Points))
lng_2 = ListLength(List=flatten(cx_2.Points))
panel = Panel(cls_2.Closed)
panel_2 = Panel(cls.Closed)
panel_3 = Panel(lng)
panel_4 = Panel(lng_2)
