# Grasshopper definition GRAPH_ML_FINAL_LAYOUTS.gh (Grasshopper 1.0.8)
# plug-ins: PlanFinderGH, eleFront

number_slider = Slider(1, range=1..20)
number_slider_2 = Slider(8, range=3..20)
number_slider_3 = Slider(3, range=0.5..20)
number_slider_4 = Slider(1.3, range=0.5..20)
number_slider_5 = Slider(2, range=1..40)  # disabled
number_slider_6 = Slider(6.8, range=0.5..20)  # disabled
number_slider_7 = Slider(1, range=1..20)  # disabled
number_slider_8 = Slider(6.1, range=0.5..20)  # disabled
number_slider_9 = Slider(3, range=0.5..20)  # disabled
number_slider_10 = Slider(1.1, range=0.5..20)  # disabled
py3 = Python3Script(
    units_per_side=Slider(17, range=1..40),
    num_floors=Slider(1, range=1..20),
    u_width=Slider(8.7, range=0.5..20),
    u_depth=Slider(11.8, range=0.5..20),
    u_height=Slider(3, range=0.5..20),
    corr_width=Slider(2, range=0.5..20))  # -> out, units, unit_names, corridors, corr_names, cores, core_names, doors, door_names; inputs units_per_side: Int32, num_floors: Int32, u_width: Double, u_depth: Double, u_height: Double, corr_width: Double
# ---------- py3: Python ----------
"""
Double-Loaded Corridor Block Generator (Offset Core Edition)
- Solves the door-overlap issue dynamically.
- Offsets the core to align with the top edge of the corridor (Side A),
  carving only into the corridor and the bottom units (Side B).
"""

import Rhino.Geometry as rg
import math

# Initialize geometry outputs
units = []
corridors = []
cores = []
doors = []

# Initialize naming outputs
unit_names = []
corr_names = []
core_names = []
door_names = []

# --- 1. Household & Core Calculation ---
total_households = units_per_side * 2 * num_floors
num_cores = max(math.ceil(units_per_side / 8), math.ceil(total_households / 40))

core_w = 4.8
core_d = 5.0
block_length = units_per_side * u_width
door_width = 1.0
door_height = 2.1
door_offset = 0.5 

# Helper function for safe boolean subtractions (3D Geometry)
def subtract_brep(base, cutters):
    current_breps = [base]
    for cutter in cutters:
        next_gen = []
        for b in current_breps:
            diff = rg.Brep.CreateBooleanDifference(b, cutter, 0.01)
            if diff is not None and len(diff) > 0:
                next_gen.extend(diff)
            else:
                next_gen.append(b) 
        current_breps = next_gen
    return current_breps

# Helper function for 1D wall segment subtraction
def get_valid_wall_segments(start, end, core_intervals):
    segments = [(start, end)]
    for cs, ce in core_intervals:
        new_segments = []
        for ss, se in segments:
            if ce <= ss or cs >= se: # No overlap
                new_segments.append((ss, se))
            else: # Core overlaps wall segment, split it
                if cs > ss:
                    new_segments.append((ss, cs))
                if ce < se:
                    new_segments.append((ce, se))
        segments = new_segments
    return segments

# --- 2. Generation Loop ---
for floor in range(num_floors):
    z = floor * u_height
    
    unit_odd_counter = 1
    unit_even_counter = 2
    corr_counter = 1
    core_counter = 1
    
    floor_units_raw = []
    floor_unit_names = []
    floor_cores_raw = []
    floor_core_names = []
    core_intervals = [] # Store 1D X-coordinates of cores for door logic
    
    # 1. Generate Cores FIRST (Offset to align with top of corridor)
    for c in range(num_cores):
        if c == 0:
            x_core = 0
        elif c == num_cores - 1:
            x_core = block_length - core_w
        else:
            step = (block_length - core_w) / (num_cores - 1)
            x_core = round((c * step) / u_width) * u_width
            
        core_intervals.append((x_core, x_core + core_w))
        
        # CHANGED: Y-interval shifted so the core is flush with the top edge of the corridor
        core_y_interval = rg.Interval((corr_width / 2) - core_d, corr_width / 2)
        core_box = rg.Box(rg.Plane.WorldXY, rg.Interval(x_core, x_core + core_w), core_y_interval, rg.Interval(z, z + u_height))
        floor_cores_raw.append(core_box.ToBrep())
        
        c_name = f"core_f{floor}_{core_counter}"
        floor_core_names.append(c_name)
        core_counter += 1

    # 2. Generate Raw Corridor
    corr_box = rg.Box(rg.Plane.WorldXY, rg.Interval(0, block_length), rg.Interval(-corr_width / 2, corr_width / 2), rg.Interval(z, z + u_height))
    floor_corr_raw = corr_box.ToBrep()
    floor_corr_name = f"corridor_f{floor}_{corr_counter}"
    corr_counter += 1
    
    # 3. Generate Raw Units & Smart Doors
    for i in range(units_per_side):
        x = i * u_width
        
        # --- Side A (Top) ---
        u_name_a = f"unit_f{floor}_{unit_odd_counter}"
        door_name_a = f"door_f{floor}_{unit_odd_counter}"
        box_a = rg.Box(rg.Plane.WorldXY, rg.Interval(x, x + u_width), rg.Interval(corr_width / 2, (corr_width / 2) + u_depth), rg.Interval(z, z + u_height))
        floor_units_raw.append(box_a.ToBrep())
        floor_unit_names.append(u_name_a)
        
        # Smart Door A Logic (Still checks core_intervals so doors don't open into the back of the core)
        valid_segments_a = get_valid_wall_segments(x, x + u_width, core_intervals)
        valid_segments_a = [seg for seg in valid_segments_a if (seg[1] - seg[0]) >= door_width]
        
        if valid_segments_a:
            best_seg = max(valid_segments_a, key=lambda seg: seg[1] - seg[0])
            door_x = best_seg[0] + door_offset
            if door_x + door_width > best_seg[1]: 
                door_x = best_seg[1] - door_width
                
            p1_a = rg.Point3d(door_x, corr_width / 2, z)
            p2_a = rg.Point3d(door_x + door_width, corr_width / 2, z)
            p3_a = rg.Point3d(door_x + door_width, corr_width / 2, z + door_height)
            p4_a = rg.Point3d(door_x, corr_width / 2, z + door_height)
            door_srf_a = rg.Brep.CreateFromCornerPoints(p1_a, p2_a, p3_a, p4_a, 0.001)
            door_srf_a.SetUserString("Name", door_name_a)
            doors.append(door_srf_a)
            door_names.append(door_name_a)
            
        unit_odd_counter += 2
        
        # --- Side B (Bottom) ---
        u_name_b = f"unit_f{floor}_{unit_even_counter}"
        door_name_b = f"door_f{floor}_{unit_even_counter}"
        box_b = rg.Box(rg.Plane.WorldXY, rg.Interval(x, x + u_width), rg.Interval(-(corr_width / 2) - u_depth, -corr_width / 2), rg.Interval(z, z + u_height))
        floor_units_raw.append(box_b.ToBrep())
        floor_unit_names.append(u_name_b)

        # Smart Door B Logic
        valid_segments_b = get_valid_wall_segments(x, x + u_width, core_intervals)
        valid_segments_b = [seg for seg in valid_segments_b if (seg[1] - seg[0]) >= door_width]
        
        if valid_segments_b:
            best_seg = max(valid_segments_b, key=lambda seg: seg[1] - seg[0])
            door_x = best_seg[1] - door_offset - door_width
            if door_x < best_seg[0]:
                door_x = best_seg[0]
                
            p1_b = rg.Point3d(door_x, -corr_width / 2, z)
            p2_b = rg.Point3d(door_x + door_width, -corr_width / 2, z)
            p3_b = rg.Point3d(door_x + door_width, -corr_width / 2, z + door_height)
            p4_b = rg.Point3d(door_x, -corr_width / 2, z + door_height)
            door_srf_b = rg.Brep.CreateFromCornerPoints(p1_b, p2_b, p3_b, p4_b, 0.001)
            door_srf_b.SetUserString("Name", door_name_b)
            doors.append(door_srf_b)
            door_names.append(door_name_b)

        unit_even_counter += 2

    # 4. Perform Boolean Difference & Assign Names
    carved_corridors = subtract_brep(floor_corr_raw, floor_cores_raw)
    for cc in carved_corridors:
        cc.SetUserString("Name", floor_corr_name) 
        corridors.append(cc)
        corr_names.append(floor_corr_name)
    
    for u, u_name in zip(floor_units_raw, floor_unit_names):
        carved_units = subtract_brep(u, floor_cores_raw)
        for cu in carved_units:
            cu.SetUserString("Name", u_name) 
            units.append(cu)
            unit_names.append(u_name)
        
    for core_brep, c_name in zip(floor_cores_raw, floor_core_names):
        core_brep.SetUserString("Name", c_name) 
        cores.append(core_brep)
        core_names.append(c_name)
# ---------- end py3 ----------
py3_2 = Python3Script(
    units_x=Slider(2, range=2..3),
    units_y=Slider(2, range=2..3),
    num_floors=number_slider,
    u_depth=number_slider_2,
    u_height=number_slider_3,
    corr_width=number_slider_4)  # -> out, units, unit_names, corridors, corr_names, cores, core_names, doors, door_names; inputs num_floors: Int32, u_depth: Double, u_height: Double
# ---------- py3_2: Python ----------
"""
Dynamic Point Block Access (Door Margin Fix)
- Generates a perimeter of units around a central core/vestibule.
- Uses dynamic slicing based on units_x (2 or 3) and units_y (2 or 3).
- Dynamically snaps doors to the closest valid vestibule wall.
- Includes a 'door_margin' to keep doors comfortably away from corners.
"""

import Rhino.Geometry as rg

# Initialize outputs
units = []
corridors = []
cores = []
doors = []
unit_names = []
corr_names = []
core_names = []
door_names = []

# --- 1. Dimensions & Setup ---
core_w = 5.0
core_d = 5.0
door_w = 1.0
door_h = 2.1

# Vestibule dimensions
v_w = core_w + (2 * corr_width)
v_d = core_d + (2 * corr_width)

# Middle unit width (leaves a 1.5m corner zone for door access)
corner_door_zone = 1.5
mid_x_w = v_w - (2 * corner_door_zone)
mid_y_d = v_d - (2 * corner_door_zone)

# Helper function for boolean subtractions
def subtract_brep(base, cutters):
    current_breps = [base]
    for cutter in cutters:
        next_gen = []
        for b in current_breps:
            diff = rg.Brep.CreateBooleanDifference(b, cutter, 0.01)
            if diff is not None and len(diff) > 0:
                next_gen.extend(diff)
            else:
                next_gen.append(b) 
        current_breps = next_gen
    return current_breps

# Helper to build vertical doors
def create_door(p1_x, p1_y, p2_x, p2_y, z):
    p1 = rg.Point3d(p1_x, p1_y, z)
    p2 = rg.Point3d(p2_x, p2_y, z)
    p3 = rg.Point3d(p2_x, p2_y, z + door_h)
    p4 = rg.Point3d(p1_x, p1_y, z + door_h)
    return rg.Brep.CreateFromCornerPoints(p1, p2, p3, p4, 0.001)

# --- 2. Define Slicing Zones ---
# Overshoot bounding boxes slightly to avoid coplanar boolean failures
huge = 1000.0 

x_intervals = []
if units_x == 2:
    x_intervals = [rg.Interval(-huge, 0), rg.Interval(0, huge)]
else: # defaults to 3
    x_intervals = [rg.Interval(-huge, -mid_x_w/2), rg.Interval(-mid_x_w/2, mid_x_w/2), rg.Interval(mid_x_w/2, huge)]

y_intervals = []
if units_y == 2:
    y_intervals = [rg.Interval(-huge, 0), rg.Interval(0, huge)]
else: # defaults to 3
    y_intervals = [rg.Interval(-huge, -mid_y_d/2), rg.Interval(-mid_y_d/2, mid_y_d/2), rg.Interval(mid_y_d/2, huge)]

# --- 3. Generation Loop ---
for floor in range(num_floors):
    z = floor * u_height
    unit_counter = 1
    
    # 1. Central Core
    core_box = rg.Box(rg.Plane.WorldXY, rg.Interval(-core_w/2, core_w/2), rg.Interval(-core_d/2, core_d/2), rg.Interval(z, z + u_height))
    core_brep = core_box.ToBrep()
    c_name = f"core_f{floor}_1"
    core_brep.SetUserString("Name", c_name)
    cores.append(core_brep)
    core_names.append(c_name)
    
    # 2. Vestibule
    vest_box = rg.Box(rg.Plane.WorldXY, rg.Interval(-v_w/2, v_w/2), rg.Interval(-v_d/2, v_d/2), rg.Interval(z, z + u_height))
    carved_vestibules = subtract_brep(vest_box.ToBrep(), [core_brep])
    corr_name = f"corridor_f{floor}_1"
    for cv in carved_vestibules:
        cv.SetUserString("Name", corr_name)
        corridors.append(cv)
        corr_names.append(corr_name)
        
    # 3. Overall Outer Perimeter (The "Donut")
    outer_w = v_w + (2 * u_depth)
    outer_d = v_d + (2 * u_depth)
    outer_box = rg.Box(rg.Plane.WorldXY, rg.Interval(-outer_w/2, outer_w/2), rg.Interval(-outer_d/2, outer_d/2), rg.Interval(z, z + u_height))
    
    # Subtract vestibule to create the empty donut
    donut_breps = subtract_brep(outer_box.ToBrep(), [vest_box.ToBrep()])
    
    # 4. Generate Door Snapping Lines 
    # --> UPDATED: This margin forces the doors away from the corner edges! <--
    door_margin = 0.4
    shrink = (door_w / 2.0) + door_margin
    
    Ln = rg.LineCurve(rg.Point3d(-v_w/2 + shrink, v_d/2, z), rg.Point3d(v_w/2 - shrink, v_d/2, z))
    Ls = rg.LineCurve(rg.Point3d(-v_w/2 + shrink, -v_d/2, z), rg.Point3d(v_w/2 - shrink, -v_d/2, z))
    Le = rg.LineCurve(rg.Point3d(v_w/2, -v_d/2 + shrink, z), rg.Point3d(v_w/2, v_d/2 - shrink, z))
    Lw = rg.LineCurve(rg.Point3d(-v_w/2, -v_d/2 + shrink, z), rg.Point3d(-v_w/2, v_d/2 - shrink, z))
    walls = [Ln, Ls, Le, Lw]

    # 5. Slice Donut and Extract Units
    for x_int in x_intervals:
        for y_int in y_intervals:
            # Overhang Z to ensure clean boolean cuts
            zone_box = rg.Box(rg.Plane.WorldXY, x_int, y_int, rg.Interval(z - 1.0, z + u_height + 1.0))
            
            for d_brep in donut_breps:
                intersection = rg.Brep.CreateBooleanIntersection(d_brep, zone_box.ToBrep(), 0.01)
                
                if intersection and len(intersection) > 0:
                    for u_brep in intersection:
                        # Only keep valid solid chunks (skips the empty center over the vestibule)
                        if u_brep.GetVolume() > 1.0:
                            
                            # --- Save Unit ---
                            u_name = f"unit_f{floor}_{unit_counter}"
                            u_brep.SetUserString("Name", u_name)
                            units.append(u_brep)
                            unit_names.append(u_name)
                            
                            # --- Generate Door Dynamically ---
                            # Find the closest vestibule wall to the unit's center
                            center = u_brep.GetBoundingBox(True).Center
                            center.Z = z # Flatten to 2D
                            
                            min_dist = 99999
                            best_wall_idx = -1
                            best_pt = None
                            
                            for i, w in enumerate(walls):
                                success, t = w.ClosestPoint(center)
                                if success:
                                    pt = w.PointAt(t)
                                    dist = center.DistanceTo(pt)
                                    if dist < min_dist:
                                        min_dist = dist
                                        best_wall_idx = i
                                        best_pt = pt
                                        
                            cx, cy = best_pt.X, best_pt.Y
                            if best_wall_idx in [0, 1]: # Snapped to North/South wall -> Door runs along X
                                door_brep = create_door(cx - door_w/2, cy, cx + door_w/2, cy, z)
                            else:                       # Snapped to East/West wall -> Door runs along Y
                                door_brep = create_door(cx, cy - door_w/2, cx, cy + door_w/2, z)
                                
                            d_name = f"door_f{floor}_{unit_counter}"
                            door_brep.SetUserString("Name", d_name)
                            doors.append(door_brep)
                            door_names.append(d_name)
                            
                            unit_counter += 1
# ---------- end py3_2 ----------
py3_3 = Python3Script(
    units_per_floor=number_slider_5,
    num_floors=number_slider,
    u_width=number_slider_6,
    u_depth=number_slider_2,
    u_height=number_slider_3,
    corr_width=number_slider_4)  # -> out, units, unit_names, corridors, corr_names, cores, core_names, doors, door_names; inputs units_per_floor: Int32, num_floors: Int32, u_width: Double, u_depth: Double, u_height: Double; disabled
# ---------- py3_3: Python ----------
"""
Point Block Access Generator (Final Edition)
- Central vertical core wrapped by a ring-shaped corridor (vestibule).
- Core is boolean-subtracted from the vestibule.
- Units attach to the North, East, South, and West faces.
- Smart Doors are placed on the dividing walls.
- Embeds floor-level metadata names.
"""

import Rhino.Geometry as rg

# Initialize geometry outputs
units = []
corridors = []
cores = []
doors = []

# Initialize naming outputs
unit_names = []
corr_names = []
core_names = []
door_names = []

# --- 1. Dimensions & Setup ---
core_w = 4.8
core_d = 5.0
door_width = 1.0
door_height = 2.1
door_offset = 0.5 

# Vestibule wraps around the core by the specified corridor width
vest_w = core_w + (2 * corr_width)
vest_d = core_d + (2 * corr_width)

# Helper function for safe 3D boolean subtractions
def subtract_brep(base, cutters):
    current_breps = [base]
    for cutter in cutters:
        next_gen = []
        for b in current_breps:
            diff = rg.Brep.CreateBooleanDifference(b, cutter, 0.01)
            if diff is not None and len(diff) > 0:
                next_gen.extend(diff)
            else:
                next_gen.append(b) 
        current_breps = next_gen
    return current_breps

# --- 2. Generation Loop ---
for floor in range(num_floors):
    z = floor * u_height
    
    unit_counter = 1
    
    # 1. Generate Central Core
    core_box = rg.Box(rg.Plane.WorldXY, rg.Interval(-core_w / 2, core_w / 2), rg.Interval(-core_d / 2, core_d / 2), rg.Interval(z, z + u_height))
    core_brep = core_box.ToBrep()
    c_name = f"core_f{floor}_1"
    
    core_brep.SetUserString("Name", c_name)
    cores.append(core_brep)
    core_names.append(c_name)
    
    # 2. Generate Vestibule (Corridor) & Subtract Core
    vest_box = rg.Box(rg.Plane.WorldXY, rg.Interval(-vest_w / 2, vest_w / 2), rg.Interval(-vest_d / 2, vest_d / 2), rg.Interval(z, z + u_height))
    vest_raw = vest_box.ToBrep()
    
    carved_vestibules = subtract_brep(vest_raw, [core_brep])
    corr_name = f"corridor_f{floor}_1"
    
    for cv in carved_vestibules:
        cv.SetUserString("Name", corr_name)
        corridors.append(cv)
        corr_names.append(corr_name)
        
    # 3. Generate Explicit Units (Max 4 for a clean cross pattern)
    actual_units = max(1, min(int(units_per_floor), 4))
    
    for i in range(actual_units):
        u_name = f"unit_f{floor}_{unit_counter}"
        door_name = f"door_f{floor}_{unit_counter}"
        
        # Unit 1: NORTH
        if i == 0:
            box_u = rg.Box(rg.Plane.WorldXY, rg.Interval(-u_width / 2, u_width / 2), rg.Interval(vest_d / 2, (vest_d / 2) + u_depth), rg.Interval(z, z + u_height))
            # Door on the South wall of the North unit
            p1 = rg.Point3d(-u_width / 2 + door_offset, vest_d / 2, z)
            p2 = rg.Point3d(-u_width / 2 + door_offset + door_width, vest_d / 2, z)
            p3 = rg.Point3d(-u_width / 2 + door_offset + door_width, vest_d / 2, z + door_height)
            p4 = rg.Point3d(-u_width / 2 + door_offset, vest_d / 2, z + door_height)
            
        # Unit 2: EAST
        elif i == 1:
            box_u = rg.Box(rg.Plane.WorldXY, rg.Interval(vest_w / 2, (vest_w / 2) + u_depth), rg.Interval(-u_width / 2, u_width / 2), rg.Interval(z, z + u_height))
            # Door on the West wall of the East unit
            p1 = rg.Point3d(vest_w / 2, -u_width / 2 + door_offset, z)
            p2 = rg.Point3d(vest_w / 2, -u_width / 2 + door_offset + door_width, z)
            p3 = rg.Point3d(vest_w / 2, -u_width / 2 + door_offset + door_width, z + door_height)
            p4 = rg.Point3d(vest_w / 2, -u_width / 2 + door_offset, z + door_height)
            
        # Unit 3: SOUTH
        elif i == 2:
            box_u = rg.Box(rg.Plane.WorldXY, rg.Interval(-u_width / 2, u_width / 2), rg.Interval(-(vest_d / 2) - u_depth, -vest_d / 2), rg.Interval(z, z + u_height))
            # Door on the North wall of the South unit (offset from right to create pinwheel symmetry)
            p1 = rg.Point3d(u_width / 2 - door_offset - door_width, -vest_d / 2, z)
            p2 = rg.Point3d(u_width / 2 - door_offset, -vest_d / 2, z)
            p3 = rg.Point3d(u_width / 2 - door_offset, -vest_d / 2, z + door_height)
            p4 = rg.Point3d(u_width / 2 - door_offset - door_width, -vest_d / 2, z + door_height)
            
        # Unit 4: WEST
        elif i == 3:
            box_u = rg.Box(rg.Plane.WorldXY, rg.Interval(-(vest_w / 2) - u_depth, -vest_w / 2), rg.Interval(-u_width / 2, u_width / 2), rg.Interval(z, z + u_height))
            # Door on the East wall of the West unit
            p1 = rg.Point3d(-vest_w / 2, u_width / 2 - door_offset - door_width, z)
            p2 = rg.Point3d(-vest_w / 2, u_width / 2 - door_offset, z)
            p3 = rg.Point3d(-vest_w / 2, u_width / 2 - door_offset, z + door_height)
            p4 = rg.Point3d(-vest_w / 2, u_width / 2 - door_offset - door_width, z + door_height)

        # Build Unit Brep
        u_brep = box_u.ToBrep()
        u_brep.SetUserString("Name", u_name)
        units.append(u_brep)
        unit_names.append(u_name)
        
        # Build Door Surface
        door_srf = rg.Brep.CreateFromCornerPoints(p1, p2, p3, p4, 0.001)
        door_srf.SetUserString("Name", door_name)
        doors.append(door_srf)
        door_names.append(door_name)
        
        unit_counter += 1
# ---------- end py3_3 ----------
py3_4 = Python3Script(
    num_units=Slider(15, range=1..40),
    num_floors=Slider(1, range=1..20),
    u_width=Slider(8.7, range=0.5..20),
    u_depth=Slider(11.8, range=0.5..20),
    u_height=Slider(3, range=0.5..20),
    corr_width=Slider(2, range=0.5..20))  # -> out, units, unit_names, corridors, corr_names, cores, core_names, doors, door_names; inputs num_units: Int32, num_floors: Int32, u_width: Double, u_depth: Double, u_height: Double, corr_width: Double
# ---------- py3_4: Python ----------
"""
Single-Loaded Corridor Block Generator (Final Edition)
- Cores stay entirely inside the bounding box (cutting through the corridor and into the units).
- Cores snap to the far left and right ends.
- Smart Doors are generated dynamically only on valid uncarved walls facing the corridor.
- Embeds floor-level metadata names (e.g., unit_f0_1, corridor_f1_1).
"""

import Rhino.Geometry as rg
import math

# Initialize geometry outputs
units = []
corridors = []
cores = []
doors = []

# Initialize naming outputs
unit_names = []
corr_names = []
core_names = []
door_names = []

# --- 1. Household & Core Calculation ---
total_households = num_units * num_floors
# Rule of thumb for single-loaded escape distances
num_cores = max(math.ceil(num_units / 6), math.ceil(total_households / 30))

core_w = 4.8
core_d = 5.0
block_length = num_units * u_width
door_width = 1.0
door_height = 2.1
door_offset = 0.5 

# Helper function for safe 3D boolean subtractions
def subtract_brep(base, cutters):
    current_breps = [base]
    for cutter in cutters:
        next_gen = []
        for b in current_breps:
            diff = rg.Brep.CreateBooleanDifference(b, cutter, 0.01)
            if diff is not None and len(diff) > 0:
                next_gen.extend(diff)
            else:
                next_gen.append(b) 
        current_breps = next_gen
    return current_breps

# Helper function for 1D wall segment calculation (for smart doors)
def get_valid_wall_segments(start, end, core_intervals):
    segments = [(start, end)]
    for cs, ce in core_intervals:
        new_segments = []
        for ss, se in segments:
            if ce <= ss or cs >= se: # No overlap
                new_segments.append((ss, se))
            else: # Core overlaps wall segment, split it
                if cs > ss:
                    new_segments.append((ss, cs))
                if ce < se:
                    new_segments.append((ce, se))
        segments = new_segments
    return segments

# --- 2. Generation Loop ---
for floor in range(num_floors):
    z = floor * u_height
    
    # Reset counters per floor
    unit_counter = 1
    corr_counter = 1
    core_counter = 1
    
    floor_units_raw = []
    floor_unit_names = []
    floor_cores_raw = []
    floor_core_names = []
    core_intervals = [] # Store 1D X-coordinates for doors
    
    # 1. Generate Cores FIRST 
    for c in range(num_cores):
        # Snap left, right, and grid distribute
        if c == 0:
            x_core = 0
        elif c == num_cores - 1:
            x_core = block_length - core_w
        else:
            step = (block_length - core_w) / (num_cores - 1)
            x_core = round((c * step) / u_width) * u_width
            
        core_intervals.append((x_core, x_core + core_w))
        
        # Core sits flush with exterior corridor edge (Y=0) and cuts inwards
        core_box = rg.Box(rg.Plane.WorldXY, rg.Interval(x_core, x_core + core_w), rg.Interval(0, core_d), rg.Interval(z, z + u_height))
        floor_cores_raw.append(core_box.ToBrep())
        
        c_name = f"core_f{floor}_{core_counter}"
        floor_core_names.append(c_name)
        core_counter += 1

    # 2. Generate Raw Corridor (Y = 0 to corr_width)
    corr_box = rg.Box(rg.Plane.WorldXY, rg.Interval(0, block_length), rg.Interval(0, corr_width), rg.Interval(z, z + u_height))
    floor_corr_raw = corr_box.ToBrep()
    floor_corr_name = f"corridor_f{floor}_{corr_counter}"
    corr_counter += 1
    
    # 3. Generate Raw Units & Smart Doors
    for i in range(num_units):
        x = i * u_width
        u_name = f"unit_f{floor}_{unit_counter}"
        door_name = f"door_f{floor}_{unit_counter}"
        
        # Unit starts exactly where the corridor ends
        box_u = rg.Box(rg.Plane.WorldXY, rg.Interval(x, x + u_width), rg.Interval(corr_width, corr_width + u_depth), rg.Interval(z, z + u_height))
        floor_units_raw.append(box_u.ToBrep())
        floor_unit_names.append(u_name)
        
        # Smart Door Logic
        valid_segments = get_valid_wall_segments(x, x + u_width, core_intervals)
        valid_segments = [seg for seg in valid_segments if (seg[1] - seg[0]) >= door_width]
        
        if valid_segments:
            best_seg = max(valid_segments, key=lambda seg: seg[1] - seg[0])
            door_x = best_seg[0] + door_offset
            if door_x + door_width > best_seg[1]: 
                door_x = best_seg[1] - door_width
                
            # Place Door on the dividing wall (Y = corr_width)
            p1 = rg.Point3d(door_x, corr_width, z)
            p2 = rg.Point3d(door_x + door_width, corr_width, z)
            p3 = rg.Point3d(door_x + door_width, corr_width, z + door_height)
            p4 = rg.Point3d(door_x, corr_width, z + door_height)
            
            door_srf = rg.Brep.CreateFromCornerPoints(p1, p2, p3, p4, 0.001)
            door_srf.SetUserString("Name", door_name)
            doors.append(door_srf)
            door_names.append(door_name)
            
        unit_counter += 1

    # 4. Perform Boolean Difference & Assign Names
    # Carve Corridors
    carved_corridors = subtract_brep(floor_corr_raw, floor_cores_raw)
    for cc in carved_corridors:
        cc.SetUserString("Name", floor_corr_name) 
        corridors.append(cc)
        corr_names.append(floor_corr_name)
    
    # Carve Units
    for u, u_name in zip(floor_units_raw, floor_unit_names):
        carved_units = subtract_brep(u, floor_cores_raw)
        for cu in carved_units:
            cu.SetUserString("Name", u_name) 
            units.append(cu)
            unit_names.append(u_name)
        
    # Process Cores
    for core_brep, c_name in zip(floor_cores_raw, floor_core_names):
        core_brep.SetUserString("Name", c_name) 
        cores.append(core_brep)
        core_names.append(c_name)
# ---------- end py3_4 ----------
py3_5 = Python3Script(num_floors=number_slider_7, u_depth=number_slider_8, u_height=number_slider_9, corr_width=number_slider_10)  # -> out, units, unit_names, corridors, corr_names, cores, core_names, doors, door_names; inputs units_per_floor: Int32, num_floors: Int32, u_width: Double, u_depth: Double, u_height: Double; disabled
# ---------- py3_5: Python ----------
"""
8-Unit Point Block Access (Custom Square Layout)
- Generates a dense perimeter of 8 units around a central core.
- Narrowed cardinal units to provide wall access for corner unit doors.
- Embeds all ML semantic metadata names.
"""

import Rhino.Geometry as rg

# Initialize geometry and metadata outputs
units = []
corridors = []
cores = []
doors = []
unit_names = []
corr_names = []
core_names = []
door_names = []

# --- 1. Dimensions & Setup ---
core_w = 5.0
core_d = 5.0
door_w = 1.0
door_h = 2.1

# Vestibule dimensions
v_w = core_w + (2 * corr_width)
v_d = core_d + (2 * corr_width)

# We reserve 1.5m on the ends of the vestibule for the corner doors
corner_door_zone = 1.5
n_w = v_w - (2 * corner_door_zone) # Width of N/S units

# Helper function for safe boolean subtractions
def subtract_brep(base, cutters):
    current_breps = [base]
    for cutter in cutters:
        next_gen = []
        for b in current_breps:
            diff = rg.Brep.CreateBooleanDifference(b, cutter, 0.01)
            if diff is not None and len(diff) > 0:
                next_gen.extend(diff)
            else:
                next_gen.append(b) 
        current_breps = next_gen
    return current_breps

# Helper to build vertical doors
def create_door(p1_x, p1_y, p2_x, p2_y, z):
    p1 = rg.Point3d(p1_x, p1_y, z)
    p2 = rg.Point3d(p2_x, p2_y, z)
    p3 = rg.Point3d(p2_x, p2_y, z + door_h)
    p4 = rg.Point3d(p1_x, p1_y, z + door_h)
    return rg.Brep.CreateFromCornerPoints(p1, p2, p3, p4, 0.001)

# --- 2. Generation Loop ---
for floor in range(num_floors):
    z = floor * u_height
    unit_counter = 1
    
    # 1. Central Core
    core_box = rg.Box(rg.Plane.WorldXY, rg.Interval(-core_w/2, core_w/2), rg.Interval(-core_d/2, core_d/2), rg.Interval(z, z + u_height))
    core_brep = core_box.ToBrep()
    c_name = f"core_f{floor}_1"
    core_brep.SetUserString("Name", c_name)
    cores.append(core_brep)
    core_names.append(c_name)
    
    # 2. Vestibule (Corridor)
    vest_box = rg.Box(rg.Plane.WorldXY, rg.Interval(-v_w/2, v_w/2), rg.Interval(-v_d/2, v_d/2), rg.Interval(z, z + u_height))
    carved_vestibules = subtract_brep(vest_box.ToBrep(), [core_brep])
    corr_name = f"corridor_f{floor}_1"
    for cv in carved_vestibules:
        cv.SetUserString("Name", corr_name)
        corridors.append(cv)
        corr_names.append(corr_name)
        
    # 3. Eight Perimeter Units
    u_boxes = []
    u_doors = []
    
    # Unit 1: NORTH
    u_boxes.append(rg.Box(rg.Plane.WorldXY, rg.Interval(-n_w/2, n_w/2), rg.Interval(v_d/2, v_d/2 + u_depth), rg.Interval(z, z + u_height)))
    u_doors.append(create_door(-door_w/2, v_d/2, door_w/2, v_d/2, z))
    
    # Unit 2: NORTHEAST Corner
    u_boxes.append(rg.Box(rg.Plane.WorldXY, rg.Interval(n_w/2, v_w/2 + u_depth), rg.Interval(v_d/2, v_d/2 + u_depth), rg.Interval(z, z + u_height)))
    dx = n_w/2 + (corner_door_zone - door_w)/2 # Center door in its zone
    u_doors.append(create_door(dx, v_d/2, dx + door_w, v_d/2, z))

    # Unit 3: EAST
    u_boxes.append(rg.Box(rg.Plane.WorldXY, rg.Interval(v_w/2, v_w/2 + u_depth), rg.Interval(-v_d/2, v_d/2), rg.Interval(z, z + u_height)))
    u_doors.append(create_door(v_w/2, -door_w/2, v_w/2, door_w/2, z))
    
    # Unit 4: SOUTHEAST Corner
    u_boxes.append(rg.Box(rg.Plane.WorldXY, rg.Interval(n_w/2, v_w/2 + u_depth), rg.Interval(-v_d/2 - u_depth, -v_d/2), rg.Interval(z, z + u_height)))
    u_doors.append(create_door(dx, -v_d/2, dx + door_w, -v_d/2, z))
    
    # Unit 5: SOUTH
    u_boxes.append(rg.Box(rg.Plane.WorldXY, rg.Interval(-n_w/2, n_w/2), rg.Interval(-v_d/2 - u_depth, -v_d/2), rg.Interval(z, z + u_height)))
    u_doors.append(create_door(-door_w/2, -v_d/2, door_w/2, -v_d/2, z))
    
    # Unit 6: SOUTHWEST Corner
    u_boxes.append(rg.Box(rg.Plane.WorldXY, rg.Interval(-v_w/2 - u_depth, -n_w/2), rg.Interval(-v_d/2 - u_depth, -v_d/2), rg.Interval(z, z + u_height)))
    dx_left = -v_w/2 + (corner_door_zone - door_w)/2
    u_doors.append(create_door(dx_left, -v_d/2, dx_left + door_w, -v_d/2, z))
    
    # Unit 7: WEST
    u_boxes.append(rg.Box(rg.Plane.WorldXY, rg.Interval(-v_w/2 - u_depth, -v_w/2), rg.Interval(-v_d/2, v_d/2), rg.Interval(z, z + u_height)))
    u_doors.append(create_door(-v_w/2, -door_w/2, -v_w/2, door_w/2, z))
    
    # Unit 8: NORTHWEST Corner
    u_boxes.append(rg.Box(rg.Plane.WorldXY, rg.Interval(-v_w/2 - u_depth, -n_w/2), rg.Interval(v_d/2, v_d/2 + u_depth), rg.Interval(z, z + u_height)))
    u_doors.append(create_door(dx_left, v_d/2, dx_left + door_w, v_d/2, z))

    # Append to outputs with names
    for i in range(8):
        u_name = f"unit_f{floor}_{unit_counter}"
        door_name = f"door_f{floor}_{unit_counter}"
        
        u_brep = u_boxes[i].ToBrep()
        u_brep.SetUserString("Name", u_name)
        units.append(u_brep)
        unit_names.append(u_name)
        
        u_doors[i].SetUserString("Name", door_name)
        doors.append(u_doors[i])
        door_names.append(door_name)
        
        unit_counter += 1
# ---------- end py3_5 ----------
swatch = ColourSwatch(SwatchColor=RGB(76, 76, 76))
swatch_2 = ColourSwatch(SwatchColor=RGB(76, 76, 76))
swatch_3 = ColourSwatch(SwatchColor=RGB(76, 76, 76))

brep = Brep(py3.units)
panel = Panel(py3.unit_names)
area = Area(Geometry=brep)  # -> Area, Centroid
tag = TextTag(Location=area.Centroid, Text=panel, Colour=swatch)
material = CreateMaterial(
    Diffuse=ColourSwatch(SwatchColor=RGB(255, 255, 255)),
    Specular=RGB(255, 255, 255),
    Emission=RGB(0, 0, 0),
    Transparency=Slider(0.74, range=0.01..1),
    Shine=0)
preview = CustomPreview(Geometry=brep, Material=material)
object = ModelObject(Geometry=brep, Name=panel, Layer="units")  # -> Object, Geometry, Name, Layer, Visibility, Display, Drafting, Render

brep_2 = Brep(py3.corridors)
panel_2 = Panel(py3.corr_names)
area_2 = Area(Geometry=brep_2)  # -> Area, Centroid
material_2 = CreateMaterial(
    Diffuse=ColourSwatch(SwatchColor=RGB(222, 60, 60)),
    Specular=RGB(255, 255, 255),
    Emission=RGB(0, 0, 0),
    Transparency=Slider(0.74, range=0.01..1),
    Shine=0)
tag_2 = TextTag(Location=area_2.Centroid, Text=panel_2, Colour=swatch)
preview_2 = CustomPreview(Geometry=brep_2, Material=material_2)
object_2 = ModelObject(Geometry=brep_2, Name=panel_2, Layer="corridors")  # -> Object, Geometry, Name, Layer, Visibility, Display, Drafting, Render

brep_3 = Brep(py3.cores)
panel_3 = Panel(py3.core_names)
area_3 = Area(Geometry=brep_3)  # -> Area, Centroid
swatch_4 = ColourSwatch(SwatchColor=RGB(255, 255, 255))
tag_3 = TextTag(Location=area_3.Centroid, Text=panel_3, Colour=swatch)
material_3 = CreateMaterial(
    Diffuse=ColourSwatch(SwatchColor=RGB(90, 163, 59)),
    Specular=RGB(255, 255, 255),
    Emission=RGB(0, 0, 0),
    Transparency=Slider(0.74, range=0.01..1),
    Shine=0)
preview_3 = CustomPreview(Geometry=brep_3, Material=material_3)
object_3 = ModelObject(Geometry=brep_3, Name=panel_3, Layer="cores")  # -> Object, Geometry, Name, Layer, Visibility, Display, Drafting, Render

srf = Surface(py3.doors)
panel_4 = Panel(py3.door_names)
area_4 = Area(Geometry=srf)  # -> Area, Centroid
tag_4 = TextTag(Location=area_4.Centroid, Text=panel_4, Colour=swatch)
preview_4 = CustomPreview(Geometry=srf, Material=ColourSwatch(SwatchColor=RGB(44, 127, 199)))
object_4 = ModelObject(Geometry=srf, Name=panel_4, Layer="doors")  # -> Object, Geometry, Name, Layer, Visibility, Display, Drafting, Render

brep_4 = Brep(py3_2.corridors)
panel_5 = Panel(py3_2.corr_names)
area_5 = Area(Geometry=brep_4)  # -> Area, Centroid
material_4 = CreateMaterial(
    Diffuse=ColourSwatch(SwatchColor=RGB(222, 60, 60)),
    Specular=RGB(255, 255, 255),
    Emission=RGB(0, 0, 0),
    Transparency=Slider(0.74, range=0.01..1),
    Shine=0)
object_5 = ModelObject(Geometry=brep_4, Name=panel_5, Layer="corridors")  # -> Object, Geometry, Name, Layer, Visibility, Display, Drafting, Render
preview_5 = CustomPreview(Geometry=brep_4, Material=material_4)
tag_5 = TextTag(Location=area_5.Centroid, Text=panel_5, Colour=swatch_2)

brep_5 = Brep(py3_2.cores)
panel_6 = Panel(py3_2.core_names)
area_6 = Area(Geometry=brep_5)  # -> Area, Centroid
material_5 = CreateMaterial(
    Diffuse=ColourSwatch(SwatchColor=RGB(90, 163, 59)),
    Specular=RGB(255, 255, 255),
    Emission=RGB(0, 0, 0),
    Transparency=Slider(0.74, range=0.01..1),
    Shine=0)
object_6 = ModelObject(Geometry=brep_5, Name=panel_6, Layer="cores")  # -> Object, Geometry, Name, Layer, Visibility, Display, Drafting, Render
preview_6 = CustomPreview(Geometry=brep_5, Material=material_5)
tag_6 = TextTag(Location=area_6.Centroid, Text=panel_6, Colour=swatch_2)

brep_6 = Brep(py3_2.units)
panel_7 = Panel(py3_2.unit_names)
area_7 = Area(Geometry=brep_6)  # -> Area, Centroid
material_6 = CreateMaterial(
    Diffuse=ColourSwatch(SwatchColor=RGB(255, 255, 255)),
    Specular=RGB(255, 255, 255),
    Emission=RGB(0, 0, 0),
    Transparency=Slider(0.74, range=0.01..1),
    Shine=0)
object_7 = ModelObject(Geometry=brep_6, Name=panel_7, Layer="units")  # -> Object, Geometry, Name, Layer, Visibility, Display, Drafting, Render
preview_7 = CustomPreview(Geometry=brep_6, Material=material_6)
tag_7 = TextTag(Location=area_7.Centroid, Text=panel_7, Colour=swatch_2)

srf_2 = Surface(py3_2.doors)
panel_8 = Panel(py3_2.door_names)
area_8 = Area(Geometry=srf_2)  # -> Area, Centroid
tag_8 = TextTag(Location=area_8.Centroid, Text=panel_8, Colour=swatch_2)
object_8 = ModelObject(Geometry=srf_2, Name=panel_8, Layer="doors")  # -> Object, Geometry, Name, Layer, Visibility, Display, Drafting, Render
preview_8 = CustomPreview(Geometry=srf_2, Material=ColourSwatch(SwatchColor=RGB(44, 127, 199)))

brep_7 = Brep(py3_4.corridors)
panel_9 = Panel(py3_4.corr_names)
area_9 = Area(Geometry=brep_7)  # -> Area, Centroid
material_7 = CreateMaterial(
    Diffuse=ColourSwatch(SwatchColor=RGB(222, 60, 60)),
    Specular=RGB(255, 255, 255),
    Emission=RGB(0, 0, 0),
    Transparency=Slider(0.74, range=0.01..1),
    Shine=0)
tag_9 = TextTag(Location=area_9.Centroid, Text=panel_9, Colour=swatch_3)
preview_9 = CustomPreview(Geometry=brep_7, Material=material_7)
object_9 = ModelObject(Geometry=brep_7, Name=panel_9, Layer="corridors")  # -> Object, Geometry, Name, Layer, Visibility, Display, Drafting, Render

brep_8 = Brep(py3_4.cores)
panel_10 = Panel(py3_4.core_names)
area_10 = Area(Geometry=brep_8)  # -> Area, Centroid
tag_10 = TextTag(Location=area_10.Centroid, Text=panel_10, Colour=swatch_3)
material_8 = CreateMaterial(
    Diffuse=ColourSwatch(SwatchColor=RGB(90, 163, 59)),
    Specular=RGB(255, 255, 255),
    Emission=RGB(0, 0, 0),
    Transparency=Slider(0.74, range=0.01..1),
    Shine=0)
preview_10 = CustomPreview(Geometry=brep_8, Material=material_8)
object_10 = ModelObject(Geometry=brep_8, Name=panel_10, Layer="cores")  # -> Object, Geometry, Name, Layer, Visibility, Display, Drafting, Render

brep_9 = Brep(py3_4.units)
panel_11 = Panel(py3_4.unit_names)
area_11 = Area(Geometry=brep_9)  # -> Area, Centroid
tag_11 = TextTag(Location=area_11.Centroid, Text=panel_11, Colour=swatch_3)
material_9 = CreateMaterial(
    Diffuse=ColourSwatch(SwatchColor=RGB(255, 255, 255)),
    Specular=RGB(255, 255, 255),
    Emission=RGB(0, 0, 0),
    Transparency=Slider(0.74, range=0.01..1),
    Shine=0)
preview_11 = CustomPreview(Geometry=brep_9, Material=material_9)
object_11 = ModelObject(Geometry=brep_9, Name=panel_11, Layer="units")  # -> Object, Geometry, Name, Layer, Visibility, Display, Drafting, Render

srf_3 = Surface(py3_4.doors)
panel_12 = Panel(py3_4.door_names)
area_12 = Area(Geometry=srf_3)  # -> Area, Centroid
tag_12 = TextTag(Location=area_12.Centroid, Text=panel_12, Colour=swatch_3)
preview_12 = CustomPreview(Geometry=srf_3, Material=ColourSwatch(SwatchColor=RGB(44, 127, 199)))
object_12 = ModelObject(Geometry=srf_3, Name=panel_12, Layer="doors")  # -> Object, Geometry, Name, Layer, Visibility, Display, Drafting, Render

debrep = DeconstructBrep(Brep=brep)  # -> Faces, Edges, Vertices
area_13 = Area(Geometry=debrep.Faces)  # -> Area, Centroid
pdecon = Deconstruct(Point=area_13.Centroid)  # -> XComponent, YComponent, ZComponent
sort = SortList(Keys=pdecon.ZComponent, ValuesA=debrep.Faces)  # -> Keys, ValuesA
item = ListItem(List=sort.ValuesA, Index=0, Wrap=True)
crv = Curve(item)
area_14 = Area(Geometry=flatten(crv))  # -> Area, Centroid
area_15 = Area(Geometry=srf)  # -> Area, Centroid
item_2 = ListItem(List=flatten(crv), Index=0, Wrap=True)  # -> Item, Item1, Item2
xy = XYPlane(Origin=area_14.Centroid)
item_3 = ListItem(List=xy, Index=0, Wrap=True)
irregular_layout_left = EleFrontDataDescription(item_2.Item1, ShiftDepth=0, isNameSet=True)
project = Project(Geometry=area_15.Centroid, Plane=item_3)  # -> Geometry, Transform
explode = Explode(Curve=irregular_layout_left, Recursive=True)  # -> Segments, Vertices
vec2pt = Vector2Pt(PointA=area_14.Centroid, PointB=project.Geometry, Unitize=False)  # -> Vector, Length
facades = ListItem(List=explode.Segments, Index=0, Wrap=True)  # -> Item, Item1
entrance = ListItem(List=flatten(project.Geometry), Index=0, Wrap=True)  # -> Item, Item1, Item2
panel_13 = Panel(vec2pt.Vector)
rectangular_layout_left = EleFrontDataDescription(item_2.Item, ShiftDepth=0, isNameSet=True)
rectangular_layout_middle = EleFrontDataDescription(item_2.Item2, ShiftDepth=0, isNameSet=True)
explode_2 = Explode(Curve=rectangular_layout_left, Recursive=True)  # -> Segments, Vertices
facades_2 = ListItem(List=explode_2.Segments, Index=Slider(3, range=0..4), Wrap=True)  # -> Item, Item1
explode_3 = Explode(Curve=rectangular_layout_middle, Recursive=True)  # -> Segments, Vertices

# ----
# PLANFINDER
# rectangular house LEFT
number_slider_11 = Slider(1.2, range=0.5..1.2)
window_facades = Data([facades_2.Item, facades_2.Item1])
boundary = Data(rectangular_layout_left)
entrance_2 = Data(entrance.Item)
fit_settings = FitSettings(
    WidthInterior=100,
    WidthExterior=200,
    DownScaling=Slider(0.8, range=0.8..1),
    UpScaling=number_slider_11,
    ThresholdScore=0,
    AmountOptions=5,
    UnitSystem=4)
panel_14 = Panel(boundary)
plan_fit = PlanFit(
    Boundary=boundary,
    EntranceS=entrance_2,
    FacadeS=window_facades,
    Beds=-1,
    Baths=-1,
    Country=26,
    FitSettings=fit_settings,
    InHousePlans=False)
layout_option = Slider(0, range=0..20)
generate = PlanGenerate(
    Boundary=boundary,
    Entrance=entrance_2,
    FacadeS=window_facades,
    Beds=-1,
    Baths=-1,
    WC=-1,
    Storage=-1,
    Kitchen=-1,
    WalkInCloset=-1,
    Meterbox=-1,
    Country=10)
plans = Data(generate)
choose_plan = ListItem(List=plans, Index=layout_option, Wrap=True)
deconstruct_plan = DeconstructPlan(Plan=choose_plan)  # -> InteriorWalls, ExteriorWalls, DoorCurves, Glass, WindowFrames, Furniture, Score, Rooms, DoorBlockInstances, FurnitureBlockInstances

facades_3 = ListItem(List=explode_3.Segments, Index=Slider(3, range=0..4), Wrap=True)

# ----
# PLANFINDER
# rectangular house MIDDLE
number_slider_12 = Slider(1.2, range=0.5..1.2)
window_facades_2 = Data(facades_3)
boundary_2 = Data(rectangular_layout_middle)
entrance_3 = Data(entrance.Item2)
fit_settings_2 = FitSettings(
    WidthInterior=100,
    WidthExterior=200,
    DownScaling=Slider(0.8, range=0.8..1),
    UpScaling=number_slider_12,
    ThresholdScore=0,
    AmountOptions=5,
    UnitSystem=4)
panel_15 = Panel(boundary_2)
plan_fit_2 = PlanFit(
    Boundary=boundary_2,
    EntranceS=entrance_3,
    FacadeS=window_facades_2,
    Beds=-1,
    Baths=-1,
    Country=26,
    FitSettings=fit_settings_2,
    InHousePlans=False)
layout_option_2 = Slider(5, range=0..20)
generate_2 = PlanGenerate(
    Boundary=boundary_2,
    Entrance=entrance_3,
    FacadeS=window_facades_2,
    Beds=-1,
    Baths=-1,
    WC=-1,
    Storage=-1,
    Kitchen=-1,
    WalkInCloset=-1,
    Meterbox=-1,
    Country=10)
plans_2 = Data(generate_2)
choose_plan_2 = ListItem(List=plans_2, Index=layout_option_2, Wrap=True)
deconstruct_plan_2 = DeconstructPlan(Plan=choose_plan_2)  # -> InteriorWalls, ExteriorWalls, DoorCurves, Glass, WindowFrames, Furniture, Score, Rooms, DoorBlockInstances, FurnitureBlockInstances

area_16 = Area(Geometry=boundary)  # -> Area, Centroid
furniture_block_instances = EleFrontDataDescription(simplify(deconstruct_plan.FurnitureBlockInstances), ShiftDepth=0, isNameSet=False)
vec2pt_2 = Vector2Pt(PointA=area_16.Centroid, PointB=entrance_2, Unitize=False)  # -> Vector, Length
door_block_instances = EleFrontDataDescription(deconstruct_plan.DoorBlockInstances, ShiftDepth=0, isNameSet=False)
window_frames = EleFrontDataDescription(deconstruct_plan.WindowFrames, ShiftDepth=0, isNameSet=False)
exterior_walls = EleFrontDataDescription(deconstruct_plan.ExteriorWalls, ShiftDepth=0, isNameSet=False)
interior_walls = EleFrontDataDescription(deconstruct_plan.InteriorWalls, ShiftDepth=0, isNameSet=False)
door_curves = EleFrontDataDescription(deconstruct_plan.DoorCurves, ShiftDepth=0, isNameSet=False)
furniture = EleFrontDataDescription(deconstruct_plan.Furniture, ShiftDepth=0, isNameSet=False)
glass = EleFrontDataDescription(deconstruct_plan.Glass, ShiftDepth=0, isNameSet=False)
score = EleFrontDataDescription(deconstruct_plan.Score, ShiftDepth=0, isNameSet=False)
rooms = EleFrontDataDescription(deconstruct_plan.Rooms, ShiftDepth=0, isNameSet=False)

deconstruct_room = DeconstructRoom(Room=rooms)  # -> Boundary, InteriorBoundary, Function
interior_boundary = EleFrontDataDescription([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], ShiftDepth=0, isNameSet=False)
boundary_3 = EleFrontDataDescription([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], ShiftDepth=0, isNameSet=False)
function = EleFrontDataDescription(["Storage", "Circulation", "Bath", "Bed", "Bed", "Living"], ShiftDepth=0, isNameSet=False)

furniture_block_instances_2 = EleFrontDataDescription(simplify(deconstruct_plan_2.FurnitureBlockInstances), ShiftDepth=0, isNameSet=False)
door_block_instances_2 = EleFrontDataDescription(deconstruct_plan_2.DoorBlockInstances, ShiftDepth=0, isNameSet=False)
entwine = Entwine(
    Branch00=interior_walls,
    Branch01=exterior_walls,
    Branch02=door_curves,
    Branch03=glass,
    Branch04=window_frames,
    Branch05=furniture,
    Branch06=score,
    Branch07=rooms,
    Branch08=door_block_instances,
    Branch09=furniture_block_instances,
    FlattenInputs=True)
window_frames_2 = EleFrontDataDescription(deconstruct_plan_2.WindowFrames, ShiftDepth=0, isNameSet=False)
exterior_walls_2 = EleFrontDataDescription(deconstruct_plan_2.ExteriorWalls, ShiftDepth=0, isNameSet=False)
interior_walls_2 = EleFrontDataDescription(deconstruct_plan_2.InteriorWalls, ShiftDepth=0, isNameSet=False)
door_curves_2 = EleFrontDataDescription(deconstruct_plan_2.DoorCurves, ShiftDepth=0, isNameSet=False)
furniture_2 = EleFrontDataDescription(deconstruct_plan_2.Furniture, ShiftDepth=0, isNameSet=False)
glass_2 = EleFrontDataDescription(deconstruct_plan_2.Glass, ShiftDepth=0, isNameSet=False)
score_2 = EleFrontDataDescription(deconstruct_plan_2.Score, ShiftDepth=0, isNameSet=False)
rooms_2 = EleFrontDataDescription(deconstruct_plan_2.Rooms, ShiftDepth=0, isNameSet=False)

deconstruct_room_2 = DeconstructRoom(Room=rooms_2)  # -> Boundary, InteriorBoundary, Function
boundary_4 = EleFrontDataDescription(deconstruct_room_2.Boundary, ShiftDepth=0, isNameSet=False)
interior_boundary_2 = EleFrontDataDescription(deconstruct_room_2.InteriorBoundary, ShiftDepth=0, isNameSet=False)
function_2 = EleFrontDataDescription(deconstruct_room_2.Function, ShiftDepth=0, isNameSet=False)
entwine_2 = Entwine(Branch00=boundary_4, Branch01=interior_boundary_2, Branch02=function_2, FlattenInputs=True)

internalised_apt = Data(Tree({0;0}: [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], {0;1}: [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], {0;2}: [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], {0;3}: [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], {0;4}: [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], {0;5}: [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], {0;6}: [0], {0;7}: ["Grasshopper.Kernel.Types.GH_ObjectWrapper", "Grasshopper.Kernel.Types.GH_ObjectWrapper", "Grasshopper.Kernel.Types.GH_ObjectWrapper", "Grasshopper.Kernel.Types.GH_ObjectWrapper", "Grasshopper.Kernel.Types.GH_ObjectWrapper", "Grasshopper.Kernel.Types.GH_ObjectWrapper"], {0;8}: [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], {0;9}: [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]))
furniture_block_instances_3 = EleFrontDataDescription([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], ShiftDepth=0, isNameSet=False)
door_block_instances_3 = EleFrontDataDescription([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], ShiftDepth=0, isNameSet=False)
window_frames_3 = EleFrontDataDescription([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], ShiftDepth=0, isNameSet=False)
exterior_walls_3 = EleFrontDataDescription([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], ShiftDepth=0, isNameSet=False)
interior_walls_3 = EleFrontDataDescription([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], ShiftDepth=0, isNameSet=False)
door_curves_3 = EleFrontDataDescription([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], ShiftDepth=0, isNameSet=False)
furniture_3 = EleFrontDataDescription([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], ShiftDepth=0, isNameSet=False)
glass_3 = EleFrontDataDescription([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], ShiftDepth=0, isNameSet=False)
score_3 = EleFrontDataDescription(0, ShiftDepth=0, isNameSet=False)
rooms_3 = EleFrontDataDescription(
    ["Grasshopper.Kernel.Types.GH_ObjectWrapper", "Grasshopper.Kernel.Types.GH_ObjectWrapper", "Grasshopper.Kernel.Types.GH_ObjectWrapper", "Grasshopper.Kernel.Types.GH_ObjectWrapper", "Grasshopper.Kernel.Types.GH_ObjectWrapper", "Grasshopper.Kernel.Types.GH_ObjectWrapper"],
    ShiftDepth=0,
    isNameSet=False)
entwine_3 = Entwine(
    Branch00=interior_walls_2,
    Branch01=exterior_walls_2,
    Branch02=door_curves_2,
    Branch03=glass_2,
    Branch04=window_frames_2,
    Branch05=furniture_2,
    Branch06=score_2,
    Branch07=rooms_2,
    Branch08=door_block_instances_2,
    Branch09=furniture_block_instances_2,
    FlattenInputs=True)
internalised_apt_2 = Data(Tree({0;0}: [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], {0;1}: [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], {0;2}: [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], {0;3}: [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], {0;4}: [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], {0;5}: [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], {0;6}: [0], {0;7}: ["Grasshopper.Kernel.Types.GH_ObjectWrapper", "Grasshopper.Kernel.Types.GH_ObjectWrapper", "Grasshopper.Kernel.Types.GH_ObjectWrapper", "Grasshopper.Kernel.Types.GH_ObjectWrapper", "Grasshopper.Kernel.Types.GH_ObjectWrapper", "Grasshopper.Kernel.Types.GH_ObjectWrapper"], {0;8}: [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], {0;9}: [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]))
area_17 = Area(Geometry=boundary_2)  # -> Area, Centroid
internalised_room_ft = Data(Tree({0;0}: [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], {0;1}: [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], {0;2}: ["Storage", "Bath", "Bed", "Circulation", "Bed", "Living"]))
pt = Point(xy)
vec = Vector(vec2pt.Vector)
vec2pt_3 = Vector2Pt(PointA=area_17.Centroid, PointB=entrance_3, Unitize=False)  # -> Vector, Length
rotate = Rotate(Geometry=vec, Angle=1.570796327, Plane=pt)  # -> Geometry, Transform
dispatch = Dispatch(List=vec, DispatchPattern=[True, False])  # -> ListA, ListB
dispatch_2 = Dispatch(List=rotate.Geometry, DispatchPattern=[True, False])  # -> ListA, ListB
vdis = VectorDisplay(Anchor=area_17.Centroid, Vector=vec2pt_3.Vector)
rev = Reverse(Vector=dispatch.ListB)
rev_2 = Reverse(Vector=dispatch_2.ListA)
pl = ConstructPlane(Origin=area_17.Centroid, XAxis=vec2pt_3.Vector, YAxis=Vector(0, 1, 0))
weave = Weave(Pattern=[0, 1], Stream0=rev, Stream1=dispatch.ListB, NullGaps=False)
weave_2 = Weave(Pattern=[0, 1], Stream0=rev_2, Stream1=dispatch_2.ListB, NullGaps=False)
group = Group(Geometry=flatten(internalised_apt_2))
pl_2 = ConstructPlane(Origin=pt, XAxis=weave, YAxis=weave_2)
orient = Orient(Geometry=group, Source=pl, Target=pl_2)  # -> Geometry, Transform
panel_16 = Panel("""-1
0
1
16
17""")
cull_i = CullIndex(List=orient.Geometry, Indices=panel_16, Wrap=True)

# ----
# PLANFINDER
# irregular house
number_slider_13 = Slider(20, range=0..100)
window_facades_3 = Data([facades.Item, facades.Item1])
boundary_5 = Data(irregular_layout_left)
entrance_4 = Data(entrance.Item1)
fit_settings_3 = FitSettings(
    WidthInterior=100,
    WidthExterior=200,
    DownScaling=Slider(0.8, range=0.8..1),
    UpScaling=Slider(1.2, range=0.5..1.2),
    ThresholdScore=0,
    AmountOptions=number_slider_13,
    UnitSystem=4)
panel_17 = Panel(boundary_5)
layout_option_3 = Slider(7, range=0..20)
plan_fit_3 = PlanFit(
    Boundary=boundary_5,
    EntranceS=entrance_4,
    FacadeS=window_facades_3,
    Beds=-1,
    Baths=-1,
    Country=26,
    FitSettings=fit_settings_3,
    InHousePlans=False)

generate_3 = PlanGenerate(
    Boundary=boundary_5,
    Entrance=entrance_4,
    FacadeS=window_facades_3,
    Beds=-1,
    Baths=-1,
    WC=-1,
    Storage=-1,
    Kitchen=-1,
    WalkInCloset=-1,
    Meterbox=-1,
    Country=10)

plans_3 = Data(generate_3)
choose_plan_3 = ListItem(List=plans_3, Index=layout_option_3, Wrap=True)
deconstruct_plan_3 = DeconstructPlan(Plan=choose_plan_3)  # -> InteriorWalls, ExteriorWalls, DoorCurves, Glass, WindowFrames, Furniture, Score, Rooms, DoorBlockInstances, FurnitureBlockInstances
