# Grasshopper definition GRAPH_ML_5455 [Jun-23 '26, 0030].gh (Grasshopper 1.0.8)

py3 = Python3Script(
    units_per_side=Slider(25, range=1..40),
    num_floors=Slider(1, range=1..20),
    u_width=Slider(8.7, range=0.5..20),
    u_depth=Slider(11.8, range=0.5..20),
    u_height=Slider(3, range=0.5..20),
    corr_width=Slider(2, range=0.5..20))  # -> out, units, unit_names, corridors, corr_names, cores, core_names; inputs units_per_side: Int32, num_floors: Int32, u_width: Double, u_depth: Double, u_height: Double, corr_width: Double
# ---------- py3: Python ----------
"""
Double-Loaded Corridor Block Generator (Metadata Edition)
Cores snap to the far left and right, and boolean differences carve out the geometry.
Assigns sequential naming logic to units (odd/even sides), corridors, and cores.
"""

import Rhino.Geometry as rg
import math

# Initialize geometry outputs
units = []
corridors = []
cores = []

# Initialize naming outputs
unit_names = []
corr_names = []
core_names = []

# Global Naming Counters (continue counting up across floors)
unit_odd_counter = 1
unit_even_counter = 2
corr_counter = 1
core_counter = 1

# --- 1. Household & Core Calculation ---
total_households = units_per_side * 2 * num_floors
num_cores = max(math.ceil(units_per_side / 8), math.ceil(total_households / 40))

core_w = 4.8
core_d = 5.0
block_length = units_per_side * u_width

# Helper function for safe boolean subtractions
def subtract_brep(base, cutters):
    current_breps = [base]
    for cutter in cutters:
        next_gen = []
        for b in current_breps:
            diff = rg.Brep.CreateBooleanDifference(b, cutter, 0.01)
            if diff is not None and len(diff) > 0:
                next_gen.extend(diff)
            else:
                next_gen.append(b) 
        current_breps = next_gen
    return current_breps

# --- 2. Generation Loop ---
for floor in range(num_floors):
    z = floor * u_height
    
    # Temporary lists for this floor before boolean
    floor_units_raw = []
    floor_unit_names = []
    floor_cores_raw = []
    floor_core_names = []
    
    # 1. Generate Raw Corridor
    corr_box = rg.Box(rg.Plane.WorldXY, rg.Interval(0, block_length), rg.Interval(-corr_width / 2, corr_width / 2), rg.Interval(z, z + u_height))
    floor_corr_raw = corr_box.ToBrep()
    
    # Assign Corridor Name
    floor_corr_name = "corridor_" + str(corr_counter)
    corr_counter += 1
    
    # 2. Generate Raw Units
    for i in range(units_per_side):
        x = i * u_width
        
        # Side A (Top / Positive Y) -> Odd Units
        box_a = rg.Box(rg.Plane.WorldXY, rg.Interval(x, x + u_width), rg.Interval(corr_width / 2, (corr_width / 2) + u_depth), rg.Interval(z, z + u_height))
        floor_units_raw.append(box_a.ToBrep())
        floor_unit_names.append("unit_" + str(unit_odd_counter))
        unit_odd_counter += 2
        
        # Side B (Bottom / Negative Y) -> Even Units
        box_b = rg.Box(rg.Plane.WorldXY, rg.Interval(x, x + u_width), rg.Interval(-(corr_width / 2) - u_depth, -corr_width / 2), rg.Interval(z, z + u_height))
        floor_units_raw.append(box_b.ToBrep())
        floor_unit_names.append("unit_" + str(unit_even_counter))
        unit_even_counter += 2

    # 3. Generate Cores (Snapped to left, right, and grid)
    for c in range(num_cores):
        if c == 0:
            x_core = 0
        elif c == num_cores - 1:
            x_core = block_length - core_w
        else:
            step = (block_length - core_w) / (num_cores - 1)
            raw_x = c * step
            x_core = round(raw_x / u_width) * u_width
            
        core_box = rg.Box(rg.Plane.WorldXY, rg.Interval(x_core, x_core + core_w), rg.Interval(-core_d / 2, core_d / 2), rg.Interval(z, z + u_height))
        floor_cores_raw.append(core_box.ToBrep())
        
        # Assign Core Name
        floor_core_names.append("core_" + str(core_counter))
        core_counter += 1

    # 4. Perform Boolean Difference & Assign Names to Final Geometry
    
    # Carve Corridors
    carved_corridors = subtract_brep(floor_corr_raw, floor_cores_raw)
    for cc in carved_corridors:
        cc.SetUserString("Name", floor_corr_name) # Embed in Brep metadata
        corridors.append(cc)
        corr_names.append(floor_corr_name)
    
    # Carve Units
    for u, u_name in zip(floor_units_raw, floor_unit_names):
        carved_units = subtract_brep(u, floor_cores_raw)
        for cu in carved_units:
            cu.SetUserString("Name", u_name) # Embed in Brep metadata
            units.append(cu)
            unit_names.append(u_name)
        
    # Process Cores
    for core_brep, c_name in zip(floor_cores_raw, floor_core_names):
        core_brep.SetUserString("Name", c_name) # Embed in Brep metadata
        cores.append(core_brep)
        core_names.append(c_name)
# ---------- end py3 ----------
py3_2 = Python3Script(
    num_units=Slider(3, range=1..40),
    num_floors=Slider(1, range=1..20),
    u_width=Slider(8.7, range=0.5..20),
    u_depth=Slider(11.8, range=0.5..20),
    u_height=Slider(3, range=0.5..20),
    corr_width=Slider(2, range=0.5..20))  # -> out, units, corridors, cores; inputs num_units: Int32, num_floors: Int32, u_width: Double, u_depth: Double, u_height: Double, corr_width: Double
# ---------- py3_2: Python ----------
"""
Single-Loaded Corridor Block Generator
Generates a side-running corridor with units arrayed on one side.
Optimizes core count based on structural escape distances.
"""

import Rhino.Geometry as rg
import math

# Initialize output lists
units = []
corridors = []
cores = []

# --- 1. Household & Core Calculation Logic ---
total_households = num_units * num_floors

# Single-loaded systems have strict single-direction egress rules.
# We place 1 core for every 6 units of length to ensure safe travel distances.
cores_by_length = math.ceil(num_units / 6)
cores_by_capacity = math.ceil(total_households / 30)
num_cores = max(cores_by_length, cores_by_capacity)

core_w = 4.8
core_d = 3.5  # Shallow core because it attaches to the exterior hallway edge
block_length = num_units * u_width

# --- 2. Geometry Generation Loop ---
for floor in range(num_floors):
    z_offset = floor * u_height
    
    # Generate the Side Corridor (running along Y = 0 to Y = corr_width)
    corr_box = rg.Box(
        rg.Plane.WorldXY,
        rg.Interval(0, block_length),
        rg.Interval(0, corr_width),
        rg.Interval(z_offset, z_offset + u_height)
    )
    corridors.append(corr_box.ToBrep())
    
    # Generate Apartment Units (Extending outwards from the corridor)
    for i in range(num_units):
        x_offset = i * u_width
        
        unit_box = rg.Box(
            rg.Plane.WorldXY,
            rg.Interval(x_offset, x_offset + u_width),
            rg.Interval(corr_width, corr_width + u_depth),
            rg.Interval(z_offset, z_offset + u_height)
        )
        units.append(unit_box.ToBrep())

    # Generate Cores on the opposite side of the corridor (Exterior face)
    for c in range(num_cores):
        if num_cores == 1:
            x_core = (block_length / 2) - (core_w / 2)
        else:
            x_core = (c * (block_length - core_w) / (num_cores - 1))
            
        core_box = rg.Box(
            rg.Plane.WorldXY,
            rg.Interval(x_core, x_core + core_w),
            rg.Interval(-core_d, 0), # Placed on the outside edge of the walkway
            rg.Interval(z_offset, z_offset + u_height)
        )
        cores.append(core_box.ToBrep())
# ---------- end py3_2 ----------
py3_3 = Python3Script(
    units_per_floor=Slider(4, range=1..40),
    num_floors=Slider(1, range=1..20),
    u_width=Slider(6, range=0.5..20),
    u_depth=Slider(11.2, range=0.5..20),
    u_height=Slider(3, range=0.5..20))  # -> out, units, corridors, cores; inputs units_per_floor: Int32, num_floors: Int32, u_width: Double, u_depth: Double, u_height: Double
# ---------- py3_3: Python ----------
"""
Point Block Access Generator
Clusters units radially (pinwheel configuration) around a singular central vertical core.
"""

import Rhino.Geometry as rg
import math

# Initialize output lists
units = []
corridors = []
cores = []

# --- 1. Household & Core Calculation Logic ---
# By architectural definition, a Point Block uses exactly ONE central core[cite: 16, 28].
# If the number of households gets too high, code dictates adding an extra elevator 
# shaft inside that same central core container rather than adding a separate room.
total_households = units_per_floor * num_floors

# Expand core size slightly if handling a high density tower configuration
if total_households > 24:
    core_w = 6.0  # Dual elevator shaft dimension
    core_d = 6.0
else:
    core_w = 4.8  # Standard single elevator + stairs layout
    core_d = 5.0

# --- 2. Geometry Generation Loop ---
for floor in range(num_floors):
    z_offset = floor * u_height
    
    # 1. Generate Central Core (Centered at 0,0,0)
    core_box = rg.Box(
        rg.Plane.WorldXY,
        rg.Interval(-core_w / 2, core_w / 2),
        rg.Interval(-core_d / 2, core_d / 2),
        rg.Interval(z_offset, z_offset + u_height)
    )
    cores.append(core_box.ToBrep())
    
    # 2. Generate Central Vestibule (Small internal corridor serving as access hub)
    # It acts as a safety buffer zone between the core and the apartment doors
    vestibule_w = core_w + 0.4
    vestibule_d = core_d + 0.4
    corr_box = rg.Box(
        rg.Plane.WorldXY,
        rg.Interval(-vestibule_w / 2, vestibule_w / 2),
        rg.Interval(-vestibule_d / 2, vestibule_d / 2),
        rg.Interval(z_offset, z_offset + u_height)
    )
    corridors.append(corr_box.ToBrep())
    
    # 3. Generate Pinwheeled Apartment Units
    # Limits units per floor automatically between 3 and 6 to preserve corner exposures [cite: 26]
    actual_units = max(3, min(int(units_per_floor), 6))
    
    for i in range(actual_units):
        # Calculate rotation angle for pinwheel distribution
        angle = (2 * math.pi / actual_units) * i
        
        # Define base rectangular unit box next to the core boundary
        # Units push out along the positive Y axis initially
        base_unit = rg.Box(
            rg.Plane.WorldXY,
            rg.Interval(-u_width / 2, u_width / 2),
            rg.Interval(vestibule_d / 2, (vestibule_d / 2) + u_depth),
            rg.Interval(z_offset, z_offset + u_height)
        ).ToBrep()
        
        # Apply transformation matrix to spin units evenly around the core center point
        rotation_center = rg.Point3d(0, 0, z_offset)
        rotation_trans = rg.Transform.Rotation(angle, rotation_center)
        base_unit.Transform(rotation_trans)
        
        units.append(base_unit)
# ---------- end py3_3 ----------
brep = Brep(py3_2.units)
brep_2 = Brep(py3_3.cores)

brep_3 = Brep(py3.corridors)
panel = Panel(py3.corr_names)
area = Area(Geometry=brep_3)  # -> Area, Centroid
tag = TextTag(Location=area.Centroid, Text=panel)
preview = CustomPreview(Geometry=brep_3, Material=ColourSwatch(SwatchColor=RGB(222, 60, 60)))
object = ModelObject(Geometry=brep_3, Name=panel, Layer="units")  # -> Object, Geometry, Name, Layer, Visibility, Display, Drafting, Render

brep_4 = Brep(py3.cores)
panel_2 = Panel(py3.core_names)
area_2 = Area(Geometry=brep_4)  # -> Area, Centroid
tag_2 = TextTag(Location=area_2.Centroid, Text=panel_2)
preview_2 = CustomPreview(Geometry=brep_4, Material=ColourSwatch(SwatchColor=RGB(90, 163, 59)))
object_2 = ModelObject(Geometry=brep_4, Name=panel_2, Layer="units")  # -> Object, Geometry, Name, Layer, Visibility, Display, Drafting, Render

brep_5 = Brep(py3.units)
panel_3 = Panel(py3.unit_names)
area_3 = Area(Geometry=brep_5)  # -> Area, Centroid
tag_3 = TextTag(Location=area_3.Centroid, Text=panel_3)
preview_3 = CustomPreview(Geometry=brep_5, Material=ColourSwatch(SwatchColor=RGB(255, 255, 255)))
object_3 = ModelObject(Geometry=brep_5, Name=panel_3, Layer="units")  # -> Object, Geometry, Name, Layer, Visibility, Display, Drafting, Render
